% Simulink data dictionary test_writer.sldd

MAX_COLOR_LEN = int32(128)

ShapeType = Simulink.Bus(DataScope="Imported", HeaderFile="ddstypes.hpp")
  x: int32
  y: int32
  shapesize: int32

HLCHello = Simulink.Bus(DataScope="Imported", HeaderFile="ddstypes.hpp")
  source_id: string
  script_running: boolean
  middleware_running: boolean